% Simulink data dictionary JointData.sldd

ia = Simulink.Signal(DataType="single")
ib = Simulink.Signal(DataType="single")
ic = Simulink.Signal(DataType="single")
ThetaOpen = Simulink.Signal(DataType="single")
spd_ki = Simulink.Parameter(0.0144, DataType="single")
CurrKi = Simulink.Parameter(35, DataType="single")
Pn = Simulink.Parameter(11)
Rs = Simulink.Parameter(6, DataType="single")
flux = Simulink.Parameter(0.005637, DataType="single")
spd_kp = Simulink.Parameter(0.3389, DataType="single")
Sig = Simulink.Signal()
CurrKp = Simulink.Parameter(0.26, DataType="single")
Sig1 = Simulink.Signal()
Sig2 = Simulink.Signal()
Udc = Simulink.Parameter(12)
L = Simulink.Parameter(0.00435, DataType="single")
id = Simulink.Signal(DataType="single")
iq = Simulink.Signal(DataType="single")