% Simulink data dictionary JointData.sldd

ia = Simulink.Signal(DataType="single")
ib = Simulink.Signal(DataType="single")
ic = Simulink.Signal(DataType="single")
ThetaOpen = Simulink.Signal(DataType="single")
Rs = Simulink.Parameter(6, DataType="single")
CurrKi = Simulink.Parameter(8, DataType="single")
CurrKp = Simulink.Parameter(0.35, DataType="single")
Pn = Simulink.Parameter(11)
Udc = Simulink.Parameter(12)
L = Simulink.Parameter(0.00335, DataType="single")
flux = Simulink.Parameter(0.00325, DataType="single")